# Dynamo graph IdentifyingDuplicatedWords.dyn (Dynamo 2.1.0.7500)

string = StringInput("\b(\w+?)\s\1\b")
all_options = FiltersByRule("IgnoreCase")
list_create = List.Create(item0=all_options)
byPattern = RegularExpressions.Regex.ByPattern(pattern=string, options=list_create)
input_string = CodeBlock { "This this is a nice day. What about this? This tastes good. I saw a a dog."; }
matches = RegularExpressions.Regex.Matches(regex=byPattern, input=input_string)
